# Grasshopper definition CurveCollide_Example2.gh (Grasshopper 1.0.7)
# plug-ins: Kangaroo2 Components, NewGrab

crv = Curve(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)
pt = Point(Point(20.91786207, 15.53984236, 0))
pt_2 = Point(Point(18.74051828, -5.456691199, 0))
area = Area(Geometry=crv)  # -> Area, Centroid
vec2pt = Vector2Pt(PointA=area.Centroid, PointB=pt_2, Unitize=False)  # -> Vector, Length
rotate = Rotate(Geometry=crv, Angle=Slider(1.311, range=0..3), Plane=area.Centroid)  # -> Geometry, Transform
move = Move(Geometry=rotate.Geometry, Motion=vec2pt.Vector)  # -> Geometry, Transform
crv_2 = Curve([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])
xy = XYPlane(Origin=pt)
cc = CurveCollide(Curves=crv_2, PassiveCurves=move.Geometry, BasePlane=PlaneXY(0, 0, 0), Strength=100)  # -> Goal, Frames
item = ListItem(List=cc.Frames, Index=0, Wrap=True)  # -> Item, Item1
toggle = BooleanToggle(True)
grab = Grab(On=True, Strength=1, Range=3)
grabfix = GrabFix(On=True, Strength=1, Range=3)
anchor = Anchor(Point=item.Item, Strength=10000)
support = Support(Frame=item.Item1, Target=xy, X=Toggle(False), Y=toggle, Z=toggle, XX=toggle, YY=toggle, ZZ=toggle, Strength=100)
solver = Solver(GoalObjects=[cc.Goal, anchor, support, grabfix], Reset=Button(), Threshold=1e-15, Tolerance=0.01, On=True)  # -> I, V, O
dot = DotDisplay(Point=solver.V)
crv_3 = Curve(solver.O)
