# Grasshopper definition newGearGoal.gh (Grasshopper 1.0.7)
# plug-ins: Kangaroo2 Components, NewGrab

radii = Panel("""1
2
3
1.5""")
brep = Brep([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])
rigidbody = RigidBody(Part=brep, Strength=10)  # -> RigidBody, Planes
shift = ShiftList(List=rigidbody.Planes, Shift=1, Wrap=False)
shift_2 = ShiftList(List=radii, Shift=1, Wrap=False)
short = ShortestList(ListA=rigidbody.Planes, ListB=shift, TrimMode=2)  # -> ListA, ListB
pln = Plane(rigidbody.Planes)
short_2 = ShortestList(ListA=radii, ListB=shift_2, TrimMode=2)  # -> ListA, ListB
pline = PolyLine(Vertices=rigidbody.Planes, Closed=False)
support = Support(Frame=rigidbody.Planes, X=False, Y=False, Z=True, XX=True, YY=True, ZZ=False, Strength=100)
division = Division(A=short_2.ListA, B=short_2.ListB)
explode = Explode(Curve=pline, Recursive=True)  # -> Segments, Vertices
grabfix = GrabFix(On=True, Strength=1, Range=3)
gear = CSharpScript(
    GearA=short.ListA,
    GearB=short.ListB,
    Ratio=division,
    Strength=10,
    Reference="/Applications/Rhino 7.app/Contents/Frameworks/RhCore.framework/Versions/A/Resources/ManagedPlugIns/GrasshopperPlugin.rhp/Components/KangarooSolver.dll")  # -> out, A; inputs GearA: Plane, GearB: Plane, Ratio: Double, Strength: Double
# ---------- gear: C# usings ----------
using System.IO;
using System.Linq;
using System.Data;
using System.Drawing;
using System.Reflection;
using System.Windows.Forms;
using System.Xml;
using System.Xml.Linq;
using System.Runtime.InteropServices;

using Rhino.DocObjects;
using Rhino.Collections;
using GH_IO;
using GH_IO.Serialization;
using KPlankton;
using KangarooSolver;
using KangarooSolver.Goals;
# ---------- gear: C# ----------
    if(Math.Abs(Ratio) > 1)
    {
      A = new Gear(GearA, GearB, Ratio, Strength);
    }
    else
    {
      A = new Gear(GearB, GearA, (1.0 / Ratio), Strength);
    }
# ---------- gear: C# additional code ----------
  public class Gear : GoalObject
  {
    public Plane P0;
    public Plane P1;
    public double Ratio;
    double startAngle0;
    double startAngle1;

    public Gear(Plane P0, Plane P1, double Ratio, double Strength)
    {
      this.P0 = P0;
      this.P1 = P1;
      this.Ratio = -Ratio;

      PPos = new Point3d[2]{P0.Origin,P1.Origin};
      Move = new Vector3d[2];
      Weighting = new double[2]{Strength,Strength};
      Torque = new Vector3d[2];
      TorqueWeighting = new double[2]{Strength,Strength};
      InitialOrientation = new Plane[2]{P0,P1};
      
      Vector3d v = P1.Origin - P0.Origin;
      Plane refPlane = new Plane(Point3d.Origin, v, Vector3d.CrossProduct(Vector3d.ZAxis, v));
      startAngle0 = Vector3d.VectorAngle(P0.YAxis,refPlane.YAxis,refPlane);
      startAngle1 = Vector3d.VectorAngle(P1.YAxis,refPlane.YAxis,refPlane);
    }

    public override void Calculate(List<KangarooSolver.Particle> p)
    {


      Plane P0 = p[PIndex[0]].Orientation;
      Plane P1 = p[PIndex[1]].Orientation;
      Vector3d v = P1.Origin - P0.Origin;
      Plane refPlane = new Plane(Point3d.Origin, v, Vector3d.CrossProduct(Vector3d.ZAxis, v));
      

      double AngleA = Vector3d.VectorAngle(P0.YAxis, refPlane.YAxis, refPlane) -startAngle0;
      double AngleB = Vector3d.VectorAngle(P1.YAxis, refPlane.YAxis, refPlane) -startAngle1;

      double BTarget = (AngleA * Ratio) % (2 * Math.PI);
      if(BTarget < 0){BTarget = (2 * Math.PI) + BTarget;}
      BTarget = BTarget % (2 * Math.PI);
      double Bdiff = BTarget - AngleB;

      if(Bdiff > Math.PI){Bdiff = Bdiff - (2 * Math.PI);}
      if(Bdiff < -Math.PI){Bdiff = Bdiff + (2 * Math.PI);}
      var V = Vector3d.ZAxis * Bdiff * 0.5;
      Torque[0] = V * Ratio;
      Torque[1] = -V;
    }
  }
# ---------- end gear ----------
length_line = LengthLine(Line=explode.Segments, Strength=10)
entwine = Entwine(Branch00=rigidbody.RigidBody, Branch01=[support, gear.A, length_line, grabfix], FlattenInputs=True)
solver = Solver(GoalObjects=entwine, Reset=Button(), Threshold=1e-15, Tolerance=0.0001, On=True)  # -> I, V, O
branch = TreeBranch(Tree=simplify(solver.O), Path="{0}", MaintainPaths=True)
preview = CustomPreview(
    Geometry=branch,
    Material=[{diffuse=RGB(243, 57, 0), emission=RGB(73, 17, 0), shine=0.5, specular=RGB(255, 255, 255), transparency=0}, {diffuse=RGB(156, 0, 119), emission=RGB(47, 0, 36), shine=0.5, specular=RGB(255, 255, 255), transparency=0}, {diffuse=RGB(1, 192, 229), emission=RGB(0, 58, 69), shine=0.5, specular=RGB(255, 255, 255), transparency=0}, {diffuse=RGB(150, 212, 20), emission=RGB(45, 64, 6), shine=0.5, specular=RGB(255, 255, 255), transparency=0}])
