# Grasshopper definition rigidbodycurvecollide.gh (Grasshopper 1.0.7)
# plug-ins: Kangaroo2 Components

xy = XYPlane(Origin=[Point(0, 0, 0), Point(17.87723428, -2.342422999, 0)])
crv = Curve([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])
anchor = Anchor(Point=Point(0, -20, 0), Strength=10000)
item = ListItem(List=xy, Index=0, Wrap=True)  # -> Item, Item1
cc = CurveCollide(Curves=crv, Frames=xy, BasePlane=PlaneXY(0, 0, 0), Strength=100)  # -> Goal, Frames
pt = Point(Point(17.87723428, 17.657577, 0))
brep = Brep(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)
pt_2 = Point([Point(0, 0, 0), Point(17.87723428, -2.342422999, 0)])
brep_2 = Brep(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)
brep_3 = Brep(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)
pt_3 = Point(Point(0, -20, 0))
grab = Grab(On=True, Strength=0.1, Range=3)
rigidbody = RigidBody(Part=brep, Plane=item.Item1, Points=pt, Strength=10)  # -> RigidBody, Planes
rigidbody_2 = RigidBody(Part=brep_3, Points=pt_2, Strength=10)  # -> RigidBody, Planes
rigidbody_3 = RigidBody(Part=brep_2, Plane=item.Item, Points=pt_3, Strength=10)  # -> RigidBody, Planes
support = Support(
    Frame=[rigidbody_3.Planes, rigidbody.Planes, rigidbody_2.Planes],
    X="false",
    Y="false",
    Z="true",
    XX="true",
    YY="true",
    ZZ="false",
    Strength=100)
solver = Solver(
    GoalObjects=[rigidbody_3.RigidBody, grab, rigidbody.RigidBody, cc.Goal, rigidbody_2.RigidBody, support, anchor],
    Reset=Button(),
    Threshold=1e-15,
    Tolerance=0.0001,
    On=True)  # -> I, V, O
