# Grasshopper definition flag.gh (Grasshopper 1.0.7)
# plug-ins: Kangaroo2 Components

rad = Radians(Degrees=Slider(-42, range=-360..360))
vec = Vector(Vector(19, 17, 0))
pt = Point([Point(5, 0, 15), Point(6, 0, 15), Point(7, 0, 15), Point(8, 0, 15), Point(9, 0, 15), Point(10, 0, 15)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])
rotate = Rotate(Geometry=vec, Angle=rad, Plane="0,0,0")  # -> Geometry, Transform
mplane = MeshPlane(Boundary={Plane=PlaneXZ(5, 0, 5), Size=Domain2(u=0..15, v=0..10)}, WidthCount=15, HeightCount=10)  # -> Mesh, Area
anchor = Anchor(Point=pt, Strength=Slider(10000, range=0..10000))
multiplication = Multiplication(A=rotate.Geometry, B=Slider(0.028, range=0..1))
tri = Triangulate(Mesh=mplane.Mesh)  # -> Mesh, Count
multiplication_2 = Multiplication(A=rotate.Geometry, B=Slider(1, range=0..10))
vdis = VectorDisplay(Anchor="0,0,0", Vector=multiplication_2)
medges = MeshEdges(Mesh=tri.Mesh)  # -> NakedEdges, InteriorEdges, NonManifoldEdges
show = Show(G=mplane.Mesh)
smooth = Smooth(M=tri.Mesh, Strength=1)
wind = Wind(Mesh=tri.Mesh, WindVector=multiplication)
length_line = LengthLine(Line=[medges.NakedEdges, medges.InteriorEdges], Strength=10)
bouncysolver = BouncySolver(
    GoalObjects=[length_line, anchor, wind, smooth, show],
    Reset=Button(),
    Threshold=1e-15,
    Tolerance=0.01,
    Damping=0.99,
    Iterations=2,
    On=Toggle(True))  # -> I, V, O
data = Data(bouncysolver.O)
